# Grasshopper definition GH_UR_RoboticAssistedMetalPolishing.gh (Grasshopper 1.0.7)
# Copyright: GPL v3
# plug-ins: HAL for Grasshopper, Robots, G E N E R A T I O N, MetaHopper

# ---- group: UPLOAD ROBOT PROGRAM THROUGH IP
# 03
# Communicate With Physical Robot
input_uploadprogram = Button()
input_playprogram = Button()
input_pauseprogram = Button()

# ----
docinfo = DocumentInfo(AutoUpdate=Button(), Recursive=False)  # -> DocumentName, DocumentFilePath, Components, Params, _3rdPartyAssemblies
# Package(s) Needed: Robot (https://www.food4rhino.com/en/app/robots)
# READ ME
# Note(s): 1. Make sure the Rhino project is in "mm".
# 3. Connect to the same network as the robots.
panel = Panel(docinfo._3rdPartyAssemblies)

# ---- group: UPLOAD ROBOT PROGRAM THROUGH IP
# Tested In: YYMMDD_In Rhino 7_weiwin.loy@hdr.qut.edu.au.
input_uploadprogram_2 = Data(input_uploadprogram)
input_pauseprogram_2 = Data(input_pauseprogram)
input_playprogram_2 = Data(input_playprogram)

# ---- group: INPUT | PARAMETER
input_toolname = Data("RobotiqGripper")
output_tcp = Data(PlaneXY(0, 0, 190))
input_toolweight_kg = Data(1.87)
mesh_toolgeometry = Data(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)

# ---- group: How robot configured?
list = FlagFields({"Shoulder": 1, "Elbow": 2, "Wrist": 4}, selected="Shoulder")
input_robotconfiguration = Data(list)

# ---- group: How fast does the robot going to move?
# 01a
input_robot_speed_mm_s = Slider(55, range=30..80)

# ---- group: How robot parameter blend together?
# HOME POSITION
input_blendradius_mm = Slider(1, range=0..100)
input_blendradius_mm_2 = Data(input_blendradius_mm)

# ----
# USER INPUTS
# BASIC PARAMETERS
# 02
# Robot Type?
robots_library = RobotsLibrary(
    {"ABB CRB15000-5", "ABB CRB15000-10", "ABB CRB15000-12", "UR3e", "UR5e", "UR10e", "UR16e", "UR3", "UR5", "UR10"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}, selected="UR10",
    Type=0)

input_robotpln = Data(PlaneXY(0, 0, 0))

# ---- group: SPECIFY END-EFFECTOR GEOMETRY
tool = CreateTool(Name=input_toolname, TCP=output_tcp, Weight=input_toolweight_kg, Mesh=mesh_toolgeometry)  # -> Tool, TCP
input_robot_endeffectortool = Data(tool.Tool)

# ---- group: How fast does the robot going to move?
# Established Robot Homing Parameters
create_speed = CreateSpeed(
    Translation=input_robot_speed_mm_s,
    Rotation=3.141592654,
    ExternalTranslation=5000,
    ExternalRotation=18.84955592,
    AccelTranslation=2500,
    AccelAxis=12.56637061)
input_robotspeed = Data(create_speed)

# ----
# AUTOMATIC INPUTS
load_robot_system = LoadRobotSystem(Name=robots_library, Base=input_robotpln)
# HELPERS
# PROCESSING FUNCTIONS
output_robottype = Data(load_robot_system)

output_robottype_2 = Data(output_robottype)

degtorad = DegreesToRadians(Degrees=[0, -90, -90, -90, 90, 0], RobotSystem=output_robottype_2, MechanicalGroup=0)
input_robotjointdegree_rad = Data(degtorad)

# ----
# 02
input_robotjointdegree_rad_2 = Data(input_robotjointdegree_rad)
input_robot_endeffectortool_2 = Data(input_robot_endeffectortool)
input_robotspeed_2 = Data(input_robotspeed)
input_blendradius_mm_3 = Data(input_blendradius_mm_2)

list_2 = ValueList({"Joint", "Linear"}, selected="Joint")  # disabled
input_robotmotiontype = Data(list_2)  # disabled

# ---- group: How fast does the robot going to move?
input_robot_speed_mm_s_2 = Slider(55, range=30..80)  # disabled

# ---- group: INPUT | PARAMETER
input_toolweight_kg_2 = Data(1.87)  # disabled
input_toolname_2 = Data("RobotiqGripper")  # disabled
output_tcp_2 = Data(PlaneXY(0, 0, 190))  # disabled
mesh_toolgeometry_2 = Data(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)  # disabled

# ----
# 03
input_cornerindexforseam = Slider(0, range=0..100)  # disabled
input_indexforseam_int = Data(input_cornerindexforseam)  # disabled

# ----
# MAIN FUNCTION
# ROBOT TOOLPATH
# 01
# Base Geometry
input_geometryradius_float = Slider(164, range=0..1000)  # disabled
input_numberofsegment_int = Slider(4, range=0..1000)  # disabled

number_slider = Slider(-1000, range=-1000..1000)  # disabled
number_slider_2 = Slider(-1000, range=-1000..1000)  # disabled
number_slider_3 = Slider(-1000, range=-1000..1000)  # disabled

input_desiredheight_mm__float = Slider(300, range=0..1000)  # disabled
# Convert Base Geometry to Target Points
input_nozzleheight_mm__float = Slider(2, range=0..10)  # disabled
input_desiredheight_mm__float_2 = Data(input_desiredheight_mm__float)  # disabled
input_nozzleheight_mm__float_2 = Data(input_nozzleheight_mm__float)  # disabled

input_desiredheight_mm__float_3 = Data(input_desiredheight_mm__float_2)  # disabled
input_nozzleheight_mm__float_3 = Data(input_nozzleheight_mm__float_2)  # disabled

# ---- group: SPECIFY END-EFFECTOR GEOMETRY
tool_2 = CreateTool(Name=input_toolname_2, TCP=output_tcp_2, Weight=input_toolweight_kg_2, Mesh=mesh_toolgeometry_2)  # -> Tool, TCP; disabled
input_robot_endeffectortool_3 = Data(tool_2.Tool)  # disabled

# ----
division = Division(A=input_desiredheight_mm__float_3, B=input_nozzleheight_mm__float_3)  # disabled
output_numberoflayer = Data(division)  # disabled

input_nozzleheight_mm__float_4 = Data(input_nozzleheight_mm__float_2)  # disabled
output_numberoflayer_2 = Data(output_numberoflayer)  # disabled

series = Series(Start=0, Step=input_nozzleheight_mm__float_4, Count=output_numberoflayer_2)  # disabled
Z = UnitZ(Factor=series)  # disabled
output_printingdirection = Data(Z)  # disabled

pt = ConstructPoint(XCoordinate=number_slider_2, YCoordinate=number_slider_3, ZCoordinate=number_slider)  # disabled
xy = XYPlane(Origin=pt)  # disabled
input_locationofmodel_pln = Data(xy)  # disabled

# ---- group: How fast does the robot going to move?
# Generate Robot Cmd
create_speed_2 = CreateSpeed(
    Translation=input_robot_speed_mm_s_2,
    Rotation=3.141592654,
    ExternalTranslation=5000,
    ExternalRotation=18.84955592,
    AccelTranslation=2500,
    AccelAxis=12.56637061)  # disabled
input_robotspeed_3 = Data(create_speed_2)  # disabled

# ----
# UI / OUTPUTS
input_geometryradius_float_2 = Data(input_geometryradius_float)  # disabled
input_numberofsegment_int_2 = Data(input_numberofsegment_int)  # disabled

input_geometryradius_float_3 = Data(input_geometryradius_float_2)  # disabled
# 02
input_numberofsegment_int_3 = Data(input_numberofsegment_int_2)  # disabled
input_locationofmodel_pln_2 = Data(input_locationofmodel_pln)  # disabled

polygon = Polygon(
    Plane=input_locationofmodel_pln_2,
    Radius=input_geometryradius_float_3,
    Segments=input_numberofsegment_int_3,
    FilletRadius=0)  # -> Polygon, Length; disabled
output_basegeometry_crv = Data(polygon.Polygon)  # disabled

output_basegeometry_crv_2 = Data(output_basegeometry_crv)  # disabled
output_printingdirection_2 = Data(output_printingdirection)  # disabled

move = Move(Geometry=output_basegeometry_crv_2, Motion=output_printingdirection_2)  # -> Geometry, Transform; disabled
explode = Explode(Curve=move.Geometry, Recursive=True)  # -> Segments, simplify(Vertices); disabled
output_targetpoints = Data(explode.Vertices)  # disabled

output_targetpoints_2 = Data(output_targetpoints)  # disabled
# 04
input_indexforseam_int_2 = Data(input_indexforseam_int)  # disabled

# ---- group: shifting target for each layer
# Seam Alignment
cull_i = CullIndex(List=output_targetpoints_2, Indices=-1, Wrap=True)  # disabled
shift = ShiftList(List=cull_i, Shift=input_indexforseam_int_2, Wrap=True)  # disabled
item = ListItem(List=output_targetpoints_2, Index=input_indexforseam_int_2, Wrap=True)  # disabled
merge = Merge(Data1=simplify(shift), Data2=item)  # -> flatten(Result); disabled

# ---- group: flip planes
xy_2 = XYPlane(Origin=merge)  # disabled
pflip = FlipPlane(Plane=xy_2, ReverseX=False, ReverseY=False, SwapAxes=True)  # disabled
output_robotprintingplane_pln = Data(pflip)  # disabled

# ----
output_robotprintingplane_pln_2 = Data(output_robotprintingplane_pln)  # disabled
input_robotconfiguration_2 = Data(input_robotconfiguration)  # disabled
input_robotmotiontype_2 = Data(input_robotmotiontype)  # disabled
input_robot_endeffectortool_4 = Data(input_robot_endeffectortool_3)  # disabled
input_robotspeed_4 = SpeedParameter(input_robotspeed_3)  # disabled

output_robotprintingplane_pln_3 = Data(output_robotprintingplane_pln)  # disabled
# 05
input_nozzleheight_mm__float_5 = Data(input_nozzleheight_mm__float_2)  # disabled

target = CreateTarget(
    Plane=output_robotprintingplane_pln_2,
    RobConf=input_robotconfiguration_2,
    Motion=input_robotmotiontype_2,
    Tool=input_robot_endeffectortool_4,
    Speed=input_robotspeed_4,
    IsCartesian=True)  # disabled
output_robottarget = TargetParameter(target)  # disabled

# ---- group: Create Pipe
# Visualisation
pline = PolyLine(Vertices=output_robotprintingplane_pln_3, Closed=False)  # disabled
pipe = Pipe(Curve=pline, Radius=input_nozzleheight_mm__float_5, Caps=2)  # disabled
output_3dprintedmodule = Data(pipe)  # disabled

# ----
geo = Geometry(<brep referenced from the Rhino model>)
bbox = BoundingBox(Content=geo, Plane=PlaneXY(0, 0, 0), UnionBox=True)  # -> Box, Box_2
boxprop = BoxProperties(Box=bbox.Box)  # -> Center, Diagonal, Area, Volume, Degeneracy
box = EvaluateBox(Box=bbox.Box, UParameter=0.5, VParameter=0.5, WParameter=1)  # -> Plane, Point, Include
devec = DeconstructVector(Vector=boxprop.Diagonal)  # -> XComponent, YComponent, ZComponent
srf = Surface(reparameterize(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))
number_slider_4 = Slider(60, range=0..100)
number_slider_5 = Slider(3, range=1..50)
merge_2 = Merge(Data1=devec.XComponent, Data2=devec.YComponent)
avr = Average(Input=merge_2)
division_2 = Division(A=avr, B=2)
dom = ConstructDomain(DomainStart=expr("x", division_2), DomainEnd=expr("-x", division_2))
rectangle = Rectangle(Plane=box.Plane, XSize=dom, YSize=dom, Radius=0)  # -> Rectangle, Length
srf_2 = Surface(rectangle.Rectangle)
sdivide = DivideSurface(Surface=reparameterize(srf_2), UCount=2, VCount=number_slider_4)  # -> simplify(Points), Normals, simplify(Parameters)
sdivide_2 = DivideSurface(Surface=srf, UCount=number_slider_4, VCount=number_slider_5)  # -> Points, Normals, simplify(Parameters)
branch = TreeBranch(Tree=sdivide.Points, Path="{1}", MaintainPaths=True)
pline_2 = PolyLine(Vertices=branch, Closed=False)  # -> flatten(Polyline)
explode_2 = Explode(Curve=pline_2, Recursive=True)  # -> Segments, simplify(Vertices)
srf_cp = SurfaceClosestPoint(Point=explode_2.Vertices, Surface=reparameterize(srf_2))  # -> Point, simplify(UVPoint), Distance
pline_3 = PolyLine(Vertices=sdivide_2.Points, Closed=False)  # -> flatten(Polyline)
dispatch = Dispatch(List=pline_3, DispatchPattern=[True, False])  # -> ListA, ListB
evalsrf = EvaluateSurface(Surface=reparameterize(srf_2), Point=srf_cp.UVPoint)  # -> Point, Normal, UDirection, VDirection, flatten(Frame)
data = Data(dispatch.ListB)
data_2 = Data(dispatch.ListA)
mesh = Mesh(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)
flip = FlipCurve(Curve=data_2)  # -> Curve, Flag
mjoin = MeshJoin(Meshes=mesh)
weave = Weave(Pattern=[0, 1], Stream0=flip.Curve, Stream1=data, NullGaps=False)
flip_2 = FlipCurve(Curve=weave)  # -> Curve, Flag
filter = StreamFilter(Gate=Toggle(True), Stream0=weave, Stream1=flip_2.Curve)
explode_3 = Explode(Curve=filter, Recursive=True)  # -> Segments, simplify(Vertices)
addition = Addition(A=number_slider_5, B=1, C=2)
data_3 = Data(graft(evalsrf.Frame))
srf_cp_2 = SurfaceClosestPoint(Point=explode_3.Vertices, Surface=srf)  # -> Point, UVPoint, Distance
repeat = RepeatData(Data=data_3, Length=addition)  # -> flatten(Data)
lng = ListLength(List=flatten(repeat))
series_2 = Series(Start=0, Step=1, Count=lng)
concat = Concatenate(FragmentA="tool", FragmentB=series_2)
number_slider_6 = Slider(20, range=0..1000)
evalsrf_2 = EvaluateSurface(Surface=srf, Point=srf_cp_2.UVPoint)  # -> Point, Normal, UDirection, VDirection, Frame
tool_3 = CreateTool(Name=concat, TCP=repeat, Weight=0, Mesh=mjoin)  # -> flatten(Tool), TCP
item_2 = ListItem(List=evalsrf_2.Frame, Index=0, Wrap=True)
item_3 = ListItem(List=evalsrf_2.Frame, Index=-1, Wrap=True)
output_tcp_tools = Data(tool_3.Tool)
output_tcp_tools_2 = Data(output_tcp_tools)
output_tcp_tools_3 = Data(output_tcp_tools)
item_4 = ListItem(List=output_tcp_tools_2, Index=[0, -1], Wrap=True)
dispatch_2 = Dispatch(List=item_4, DispatchPattern=[True, False])  # -> OUTPUT_FirstTCP, OUTPUT_LastTCP
pl_offset = PlaneOffset(BasePlane=item_2, Offset=number_slider_6)
pl_offset_2 = PlaneOffset(BasePlane=item_3, Offset=number_slider_6)
merge_3 = Merge(Data1=pl_offset, Data2=evalsrf_2.Frame, Data3=pl_offset_2)
data_4 = Data(flatten(merge_3))
null = NullItem(Item=data_4)  # -> NullFlags, InvalidFlags, Description
cull = CullPattern(List=data_4, CullPattern=invert(null.NullFlags))
pflip_2 = FlipPlane(Plane=cull, ReverseX=False, ReverseY=False, SwapAxes=True)
output_lasttcp_tool = Data(dispatch_2.OUTPUT_LastTCP)
output_lasttcp_tool_2 = Data(output_lasttcp_tool)
output_firsttcp_tool = Data(dispatch_2.OUTPUT_FirstTCP)
output_firsttcp_tool_2 = Data(output_firsttcp_tool)

# ----
# Compiler into Robot Language
target_2 = CreateTarget(
    Joints=input_robotjointdegree_rad_2,
    Tool=output_firsttcp_tool_2,
    Speed=input_robotspeed_2,
    Zone=input_blendradius_mm_3,
    IsCartesian=False)
output_robottarget_home = TargetParameter(target_2)

output_firsttcp_tool_3 = Data(output_firsttcp_tool)
merge_4 = Merge(Data1=output_firsttcp_tool_3, Data2=output_tcp_tools_3, Data3=output_lasttcp_tool_2)
output_robottool = Data(merge_4)
bbox_2 = BoundingBox(Content=pflip_2, Plane=PlaneXY(0, 0, 0), UnionBox=True)  # -> Box, Box_2
neg = Negative(Value=Slider(100, range=0..1000))
item_5 = ListItem(List=pflip_2, Index=[0, -1], Wrap=True)
pl_offset_3 = PlaneOffset(BasePlane=item_5, Offset=neg)
box_2 = EvaluateBox(Box=bbox_2.Box, UParameter=0.5, VParameter=0.5, WParameter=1)  # -> Plane, Point, Include
dispatch_3 = Dispatch(List=pl_offset_3, DispatchPattern=[True, False])  # -> ListA, ListB
project = Project(Geometry=dispatch_3.ListB, Plane=box_2.Plane)  # -> Geometry, Transform
merge_5 = Merge(Data1=dispatch_3.ListA, Data2=pflip_2, Data3=dispatch_3.ListB, Data4=project.Geometry)
output_robottool_2 = Data(simplify(graft(output_robottool)))
input_robotspeed_5 = SpeedParameter(input_robotspeed_3)
data_5 = Data(simplify(graft(merge_5)))
list_3 = ValueList({"Joint", "Linear"}, selected="Linear")
target_3 = CreateTarget(
    Plane=data_5,
    Motion=list_3,
    Tool=output_robottool_2,
    Speed=input_robotspeed_5,
    Zone=Slider(1, range=0..10),
    IsCartesian=True)  # -> flatten(Target)
output_robottargetpath = TargetParameter(target_3)
output_robottargetpath_2 = TargetParameter(output_robottargetpath)

input_programname = Panel("program")
input_programindex = Panel("01_")

merge_6 = Merge(Data1=flatten(output_robottarget_home), Data2=flatten(output_robottargetpath_2), Data3=flatten(output_robottarget_home))
target_4 = TargetParameter(merge_6)
target_5 = TargetParameter(target_4)

output_robottarget_routine = TargetParameter()
# CREATE PROGRAM & SENT IT
output_robottarget_home_2 = TargetParameter(output_robottarget_home)

# ---- group: Online control via Ethernet
input_useofflinesimulator = BooleanToggle(False)
input_useftpupload = BooleanToggle(False)

# ---- group: SAFE ROBOT PROGRAM
input_saveprogram_bool = Button()
input_robotpath = Panel("C:\Users\loywe\OneDrive - Queensland University of Technology\Phd Loy Wei Win")
# Save Program (USB)
input_saveprogram_bool_2 = Data(input_saveprogram_bool)
input_robotpath_2 = Data(input_robotpath)

# ----
input_saveprogram_bool_3 = Data(input_saveprogram_bool_2)
input_uploadprogram_3 = Data(input_uploadprogram_2)

or = GateOr(A=input_saveprogram_bool_3, B=input_uploadprogram_3)

get_current_time = GetCurrentTime(get_time=or)  # -> out, time_string; inputs get_time: Boolean
# ---------- get_current_time: Python ----------
__author__ = "WeiWinLoy"

import rhinoscriptsyntax as rs
from datetime import datetime 

def give_time(): 
    time = datetime.now()
    time_string = time.strftime("%y%m%d_%H%M%S")
    return time_string
    
if get_time: 
    time_string = give_time()
# ---------- end get_current_time ----------
# COMMENT: The new program sent to the robot via ftp will only be automatically loaded if it has a different name than the one that was sent previously.
# We change the name of the program  by appending the current date and time
input_getcurrenttime = Data(get_current_time.time_string)

input_getcurrenttime_2 = Data(input_getcurrenttime)

concatenate = Concatenate(Fragment_A=input_programname, Fragment_B=input_programindex, Fragment_C=input_getcurrenttime_2)
output_programname = Data(concatenate)

# ---- group: CREATE PROGRAM
# 01
output_programname_2 = Data(output_programname)
output_robottype_3 = RobotSystemParameter(output_robottype)
output_robottarget_2 = TargetParameter(target_5)

# ----
merge_7 = Merge(Data1=output_robottarget_home_2, Data2=output_robottarget_routine, Data3=output_robottarget_home_2)  # -> flatten(Result)
output_robottarget_3 = Data(merge_7)

# ---- group: CREATE PROGRAM
# Create Basic Program
program = CreateProgram(Name=output_programname_2, RobotSystem=output_robottype_3, Targets=output_robottarget_2, StepSize=1)  # -> Program, Code, Duration, Warnings, Errors
output_program = ProgramParameter(program.Program)
output_errormessage = Data(program.Errors)
output_programcode = Data(program.Code)
output_warnings = Data(program.Warnings)

# ----
# 02a
output_errors = Data(output_errormessage)
output_errors_2 = Panel(output_errors)

input_robotpath_3 = Data(input_robotpath_2)
output_program_2 = Data(output_program)

saveprog = SaveProgram(Program=output_program_2, Folder=input_robotpath_3)

output_warnings_2 = Data(output_warnings)
output_warnings_3 = Panel(output_warnings_2)

session_settings = SessionSettings()

# ---- group: BACKEND
output_errormessage_2 = Data(output_errormessage)
output_programcode_2 = Data(output_programcode)

loy_backendchecking = LOY_BackendChecking(output_programcode=output_programcode_2, output_error=output_errormessage_2)  # -> output_needtouseftpupload_2, output_colorvalue_2, output_error_4, output_textmessage_2
output_robotmesh_colour = Data(loy_backendchecking.output_colorvalue_2)
input_needtouseftpupload = Data(loy_backendchecking.output_needtouseftpupload_2)

# ---- group: Online control via Ethernet
# COMMENT: Use FTP Upload if you are going to sent a long code.
input_needtouseftpupload_2 = Data(input_needtouseftpupload)
input_robotip = Panel("192.168.1.180")
input_ftp_ursim_filepath = Panel("/home/ur/ursim-current/programs/")
# Remote Control
or_2 = GateOr(A=input_useftpupload, B=input_needtouseftpupload_2)

establish_robotipformat = Establish_RobotIPFormat(
    input_useofflinesimulator=input_useofflinesimulator,
    input_useftpupload=or_2,
    input_robotip=input_robotip,
    ftp_ursim_filepath=input_ftp_ursim_filepath)  # -> flatten(robotip_txt_2)
input_robotip_2 = Data(establish_robotipformat)

# ----
input_robotip_3 = Data(input_robotip_2)
input_uploadprogram_4 = Data(input_uploadprogram_2)
input_playprogram_3 = Data(input_playprogram_2)
# 02b
input_pauseprogram_3 = Data(input_pauseprogram_2)
output_program_3 = Data(output_program)

remote_connection = RemoteConnection(
    Program=output_program_3,
    IP=input_robotip_3,
    Upload=input_uploadprogram_4,
    Play=input_playprogram_3,
    Pause=input_pauseprogram_3)
panel_2 = Panel(remote_connection)

# ---- group: BACKEND (continued)
output_containederror_bool = Boolean(loy_backendchecking.output_error_4)
output_textmessage = Data(loy_backendchecking.output_textmessage_2)

# ----
# VISUALISE ISSUE IN COMPUTER
output_program_4 = ProgramParameter(output_program)
trigger = Trigger(Interval=10, TimerInterval=10, Target=count)
input_pausesimulation = Button()
output_error = Boolean(invert(output_containederror_bool))
input_startsimulation = BooleanToggle(True)
and = GateAnd(A=output_error, B=input_startsimulation)
count = Counter(Start=0, Step=0.01, Pause=input_pausesimulation, Reset=invert(and))
sim = ProgramSimulation(Program=output_program_4, Time=count, Normalized=invert(True))  # -> SystemMeshes, JointRotations, Plane, Index, Time, Program, Errors
draw_trail = DrawTrail(P=sim.Program)
output_robotmesh_colour_2 = Data(output_robotmesh_colour)
output_textmessage_2 = Data(output_textmessage)
cluster = Cluster(input_textmessage=output_textmessage_2, G=sim.SystemMeshes, M=output_robotmesh_colour_2, L=sim.Plane)

# ==== cluster Cluster
L = ClusterInput()
item = ListItem(List=L, Index=-1, Wrap=True)
input_textmessage = ClusterInput()
msphere = MeshSphere(Base=item, Radius=Slider(5, range=0..10), UCount=10, VCount=20)
M = ClusterInput()
G = ClusterInput()
preview = CustomPreview(Geometry=msphere, Material=M)
input_textmessage_2 = Data(input_textmessage)
preview_2 = CustomPreview(Geometry=G, Material=M)
tag = TextTag(Location=item, Text=input_textmessage_2, Colour=ColourSwatch(SwatchColor=RGBA(122, 114, 114, 158)))

# ==== cluster Establish_RobotIPFormat
input_useofflinesimulator = ClusterInput()
input_useftpupload = ClusterInput()
input_robotip = ClusterInput()
ftp_ursim_filepath = ClusterInput()
input_useofflinesimulator_2 = Boolean(input_useofflinesimulator)
input_useftpupload_2 = Boolean(input_useftpupload)
input_robotip_2 = Text(input_robotip)
ftp_ursim_login = Panel("ur:easybot@")
ftp_ursim_filepath_2 = Text(ftp_ursim_filepath)
ftp_prefix = Panel("sftp://")
concatenate = Concatenate(Fragment_A=ftp_prefix, Fragment_C=input_robotip_2)
concatenate_2 = Concatenate(Fragment_A=ftp_prefix, Fragment_B=ftp_ursim_login, Fragment_C=input_robotip_2, A=ftp_ursim_filepath_2)
stream_filter = StreamFilter(Gate=input_useofflinesimulator_2, Stream0=concatenate, Stream1=concatenate_2)
stream_filter_2 = StreamFilter(Gate=input_useftpupload_2, Stream0=input_robotip_2, Stream1=stream_filter)
robotip_txt = Text(stream_filter_2)
robotip_txt_2 = ClusterOutput(robotip_txt)

# ==== cluster LOY_BackendChecking
output_programcode = ClusterInput()
output_error = ClusterInput()
output_programcode_2 = Data(output_programcode)
number_slider = Slider(2000, range=0..10000)
lng = ListLength(List=output_programcode_2)
output_error_2 = Data(output_error)
txt = Text(ColourSwatch(SwatchColor=RGBA(255, 102, 102, 129)))
txt_2 = Text(ColourSwatch(SwatchColor=RGBA(255, 255, 255, 81)))
expression = Expression(x=lng, y=number_slider, Expression="if(x≥y,true,false)")
expression_2 = Expression(x=lng, y=number_slider, a=txt, b=txt_2, Expression="if(x≥y,a,b)")
expression_3 = Expression(x=lng, y=number_slider, a=txt, b=txt_2, Expression="if(x≥y,\"Too many planes\",\"\")")
null = NullItem(Item=output_error_2)  # -> NullFlags, InvalidFlags, Description
avr = Average(Input=null.NullFlags)
col = Colour(expression_2)
output_needtouseftpupload = Data(expression)
filter = StreamFilter(Gate=avr, Stream0="Error", Stream1=expression_3)
filter_2 = StreamFilter(Gate=avr, Stream0=ColourSwatch(SwatchColor=RGB(255, 0, 0)), Stream1=col)
output_needtouseftpupload_2 = ClusterOutput(output_needtouseftpupload)
output_error_3 = Boolean(invert(avr))
output_colorvalue = Data(filter_2)
output_textmessage = Data(filter)
output_colorvalue_2 = ClusterOutput(output_colorvalue)
output_error_4 = ClusterOutput(output_error_3)
output_textmessage_2 = ClusterOutput(output_textmessage)

# ==== cluster DrawTrail
P = ClusterInput()

# ---- group: Draw trail
trail = SimpleTrail(Program=P, Length=Slider(100000, range=0..100000), MechanicalGroup=0)
swatch = ColourSwatch(SwatchColor=RGB(255, 255, 255))

# ----
preview = CustomPreview(Geometry=trail, Material=swatch)
